# Grasshopper definition SOAR_Object_B-half.gh (Grasshopper 1.0.7)

circle = Circle(Plane=PlaneXY(0, 0, 20), Radius=9.8)
circle_2 = Circle(Plane=PlaneXY(0, 0, 19.5), Radius=10)
circle_3 = Circle(Plane=PlaneXY(0, 0, 10.25), Radius=9.8)
circle_4 = Circle(Plane=PlaneXY(0, 0, 10), Radius=10)
circle_5 = Circle(Plane=PlaneXY(0, 0, 9.75), Radius=9.8)
circle_6 = Circle(Plane=PlaneXY(0, 0, 0.5), Radius=10)
circle_7 = Circle(Plane=PlaneXY(0, 0, 0), Radius=9.8)
circle_8 = Circle(Plane=PlaneXY(0, 0, 18), Radius=7)
circle_9 = Circle(Plane=PlaneXY(0, 0, 11.5), Radius=7)
circle_10 = Circle(Plane=PlaneXY(0, 0, 8.5), Radius=7)
circle_11 = Circle(Plane=PlaneXY(0, 0, 2), Radius=7)
surface = Surface(circle)
circle_12 = Circle(Plane=PlaneXY(0, 0, 15.75), Radius=3.5)
circle_13 = Circle(Plane=PlaneXY(0, 0, 14.25), Radius=3.5)
circle_14 = Circle(Plane=PlaneXY(0, 0, 5.75), Radius=3.5)
circle_15 = Circle(Plane=PlaneXY(0, 0, 4.25), Radius=3.5)
surface_2 = Surface(circle_7)
merge = Merge(
    Data1=circle,
    Data2=circle_2,
    Data3=circle_8,
    Data4=circle_12,
    Data5=circle_13,
    Data6=circle_9,
    Data7=circle_3,
    Data8=circle_4,
    Data9=circle_5,
    Data10=circle_10,
    Data11=circle_14,
    Data12=circle_15,
    Data13=circle_11,
    Data14=circle_6,
    Data15=circle_7)
conversion = Conversion(T=surface, M=merge, B=surface_2)
mesh_join = MeshJoin(Meshes=conversion)
monitoring = Monitoring(mesh=mesh_join)  # -> X_2, Y_2, Z_2
panel = Panel(monitoring.X_2)
panel_2 = Panel(monitoring.Y_2)
panel_3 = Panel(monitoring.Z_2)

# ==== cluster Conversion
T = ClusterInput()
M = ClusterInput()
B = ClusterInput()
T_2 = Data(T)
M_2 = Data(M)
B_2 = Data(B)
loft = Loft(Curves=M_2, Options={Adjust=False, Closed=False, LoftEnds=0, LoftSimp=2, LoftType=2, Rebuild=10, Refit=0.01})
merge = Merge(Data1=T_2, Data2=loft, Data3=B_2)
rotate_axis = RotateAxis(Geometry=merge, Angle=1.570796327, Axis=Line((0, 0, 0), (0, 10, 0)))  # -> Geometry, Transform
mesh_brep = MeshBrep(
    Brep=rotate_axis.Geometry,
    Settings={GridMaxCount=0, GridMinCount=16, JaggedSeams=False, MaxEdgeLength=0, MinEdgeLength=0.0001, MinTolerance=0, Refine=True, RefineAngle=0, RelativeTolerance=0.65, SimplePlanes=True, Tolerance=0})
meshes = Data(mesh_brep)
meshes_2 = ClusterOutput(meshes)

# ==== cluster Monitoring
mesh = ClusterInput()
mesh_2 = Data(mesh)
bounding_box = BoundingBox(Content=mesh_2, Plane=PlaneXY(0, 0, 0))  # -> Box, Box_2
box_properties = BoxProperties(Box=bounding_box.Box)  # -> Center, Diagonal, Area, Volume, Degeneracy
deconstruct_vector = DeconstructVector(Vector=box_properties.Diagonal)  # -> XComponent, YComponent, ZComponent
X = Data(deconstruct_vector.XComponent)
Y = Data(deconstruct_vector.YComponent)
Z = Data(deconstruct_vector.ZComponent)
X_2 = ClusterOutput(X)
Y_2 = ClusterOutput(Y)
Z_2 = ClusterOutput(Z)
